# Dynamo graph Notion Issuer.dyn (Dynamo 2.3.0.5885)
# packages: Clockwork for Dynamo 2.x 2.3.0, DynaWeb 1.0.3, JsonData 2.0.2

# group: Packages
# note: Clockwork |  v.2.3.0
# DynaWeb |  v.1.0.3
# JsonData |  v.2.0.2

# group: Guide
# note: go to https://developers.notion.com/docs/getting-started#getting-started follow the guide to create a new integration and to share a Notion DB with the new integration you created.
# Paste the Internal Integration Token and the Notion DB Id in the code block above (how to get the DB Id in the gatting started page)
# go to https://api.imgbb.com/ , register, generate a new API key and paste it in the code block above.
# set up your Notion DB with at least those fields:
# Title ->data type Title
# Desctiption -> data type Text
# Attachment -> data type Files & media
# Status -> data type Select (create at least one status called "OPEN")
# Due date -> data type Date
# you can also add a new view to the DB and set it to a Board if you're really wanna be fancy

# group: Saving the Active View as a jpg in the model directory
python_script = Python()  # unwired: IN[0]
# ---------- python_script.python (11 lines) ----------
import clr

clr.AddReference("RevitServices")
import RevitServices
from RevitServices.Persistence import DocumentManager
doc = DocumentManager.Instance.CurrentDBDocument
clr.AddReference("RevitNodes")
import Revit
clr.ImportExtensions(Revit.Elements)

OUT = doc.PathName 
# ----------------------------------------
directoryName = FileSystem.DirectoryName(path=python_script)
python_script_2 = Python()  # unwired: IN[0]
# ---------- python_script_2.python (11 lines) ----------
import clr

clr.AddReference("RevitServices")
import RevitServices
from RevitServices.Persistence import DocumentManager
doc = DocumentManager.Instance.CurrentDBDocument
clr.AddReference("RevitNodes")
import Revit
clr.ImportExtensions(Revit.Elements)

OUT = doc.ActiveView.ToDSType(True)
# ----------------------------------------
name = Custom[Element.Name+](element=python_script_2)  # package Clockwork for Dynamo 2.x; Gets an element's name. Unlike the OOTB node, this node should work for all Revit elements that have names and will also return the localized names of system parameters, parameter groups, display unit types, parameter types, unit symbol types and unit types.
now = DateTime.Now()
code_block = CodeBlock { "yyyy-MM-dd-hh-mm-ss"; }
format = DateTime.Format(dateTime=now, format=code_block)
code_block_2 = CodeBlock(a=directoryName, wn=name, ts=format) { a+"\\"+wn+"_"+ts+".jpg"; wn+"_"+ts; }
exportAsImage = View.ExportAsImage(view=python_script_2, path=code_block_2.out0)
code_block_3 = CodeBlock(a=code_block_2.out0, b=exportAsImage) { [a,b][0]; }

notion_page_creation_endpoint = CodeBlock { "https://api.notion.com/v1/pages"; }
imgbb_upload_endpoint = CodeBlock { "https://api.imgbb.com/1/upload"; }
your_api_keys = CodeBlock()
# ---------- your_api_keys.designscript (8 lines) ----------
//imgBB Key Here:
"YOUR_IMGBB_KEY";

//Internal Integration Token:
"YOUR_NOTION_INTEGRATION_TOKEN";

//Notion DB Id Here:
"YOUR_NOTION_DB_ID";
# ----------------------------------------
code_block_4 = CodeBlock(a=your_api_keys.out0, b=your_api_keys.out1, c=your_api_keys.out2) { a; b; c; }
code_block_5 = CodeBlock(a=code_block_4.a, b=code_block_4.b) { a; b; }

# group: Uploading the Active View to imgBB. Notion API doesn't support image upload so we are going to upload it to imgBB and then pass the url to Notion.
byUrl = DynaWeb.WebRequest.ByUrl(url=imgbb_upload_endpoint)
code_block_6 = CodeBlock(imgBBKey=code_block_5.a) { "key"; imgBBKey; "QueryString"; }
addParameter = DynaWeb.WebRequest.AddParameter(webRequest=byUrl, name=code_block_6.out0, value=code_block_6.imgBBKey, parameterType=code_block_6.out2)
code_block_7 = CodeBlock { "POST"; }
setMethod = DynaWeb.WebRequest.SetMethod(webRequest=addParameter, method=code_block_7)
code_block_8 = CodeBlock { "image"; }
string = StringInput("image/jpeg")
addFile = DynaWeb.WebRequest.AddFile(webRequest=setMethod, name=code_block_8, path=code_block_3, contentType=string)
execute = DynaWeb.WebRequest.Execute(request=addFile)

# group: Reading the imgBB response and extracting the image url
content = DynaWeb.WebResponse.Content(webResponse=execute)
string_2 = JsonData.Utilities.Parse.String(jsonString=content)
code_block_9 = CodeBlock { "data.url"; }
getValueByKey = JsonObject.GetValueByKey(jsonObject=string_2, keys=code_block_9, Nesting=true, Option="None")

# group: This to force the second request after the response of the first
code_block_10 = CodeBlock(d=notion_page_creation_endpoint, w=getValueByKey) { [d,w][0]; }

notion_post_body_json_template = StringInput("""{
  "parent": {
    "database_id": "##DBID##"
  },
  "properties": {
    "Title": {
      "title": [
        {
          "text": {
            "content": "##TITLE##"
          }
        }
      ]
    },
    "Description": {
      "rich_text": [
        {
          "text": {
            "content": "##DESCRIPTION##"
          }
        }
      ]
    },
    "Attachment": {
      "files": [
        {
          "external": {
            "url": "##URL##"
          },
          "name": "##TITLE##"
        }
      ]
    },
    "Status": {
      "select": {
        "name": "OPEN"
      }
    }##ADDDATE##},
  "cover": {
    "external": {
      "url": "##URL##"
    }
  }
}
""")
code_block_11 = CodeBlock { "##DBID##"; }
code_block_12 = CodeBlock(a=code_block_4.c) { a; }
replace = String.Replace(str=notion_post_body_json_template, searchFor=code_block_11, replaceWith=code_block_12)
code_block_13 = CodeBlock(a=replace) { a; }

# group: Input
issue_title = StringInput("")  # graph input
issue_description = StringInput("")  # graph input
due_date_format_yyyy_mm_dd = StringInput("")  # graph input

# group: Validating the date
python_script_3 = Python(IN[0]=due_date_format_yyyy_mm_dd)
# ---------- python_script_3.python (45 lines) ----------
import clr
clr.AddReference('ProtoGeometry')
from Autodesk.DesignScript.Geometry import *

clr.AddReference('DSCoreNodes') 
import DSCore
from DSCore import *

clr.AddReference('RevitAPI')
from Autodesk.Revit.DB import *

clr.AddReference("RevitAPIUI")
from Autodesk.Revit.UI import *

clr.AddReference("RevitNodes")
import Revit
clr.ImportExtensions(Revit.Elements)

clr.AddReference("RevitServices")
import RevitServices
from RevitServices.Persistence import DocumentManager
from RevitServices.Transactions import TransactionManager

doc = DocumentManager.Instance.CurrentDBDocument

datestr = IN[0]
result = []

if datestr == "":
	result.append(None)
	result.append(False)
else:
	try:
		DSCore.DateTime.FromString(datestr)
		result.append(datestr)
		result.append(True)
	except:
		dialog = TaskDialog("Hey!")
		dialog.MainInstruction = "Didn't post the Issue.\n\nDate Format is wrong."
		dialog.Show()
		result.append(datestr)
		result.append(True)

#Assign your output to the OUT variable.
OUT = result
# ----------------------------------------
code_block_14 = CodeBlock(a=python_script_3) { a[0]; a[1]; }

code_block_15 = CodeBlock(IssueTitle=issue_title, IssueDescription=issue_description, IssueDueDate=code_block_14.out0, addDate=code_block_14.out1) { IssueTitle; IssueDescription; IssueDueDate; addDate; }
code_block_16 = CodeBlock(IssueTitle=code_block_15.IssueTitle, IssueDescription=code_block_15.IssueDescription, IssueDueDate=code_block_15.IssueDueDate, addDate=code_block_15.addDate) { IssueTitle; IssueDescription; IssueDueDate; addDate; }
date_chunk_json_template = StringInput(""",
    "Due Date": {
      "date": {
        "start": "##DUEDATE##",
        "end": null
      }
    }""")

# group: Processing the Due Date chunk and erasing it if no date is provided
code_block_17 = CodeBlock { "##DUEDATE##"; }
replace_2 = String.Replace(str=date_chunk_json_template, searchFor=code_block_17, replaceWith=code_block_16.IssueDueDate)
code_block_18 = CodeBlock(a=code_block_16.addDate, d=replace_2) { a?d:""; }

code_block_19 = CodeBlock(IssueTitle=code_block_16.IssueTitle, IssueDescription=code_block_16.IssueDescription, dateChunk=code_block_18) { IssueTitle; IssueDescription; dateChunk; }
list_create = List.Create(item0=getValueByKey, item1=code_block_19.IssueTitle, item2=code_block_19.IssueDescription)

# group: Parsing the Json template to add all the issue variables and the "Due Date" property (if specified)
code_block_20 = CodeBlock()
# ---------- code_block_20.designscript (5 lines) ----------
[
"##URL##",
"##TITLE##",
"##DESCRIPTION##"
];
# ----------------------------------------
replaceMultiple = Custom[String.ReplaceMultiple](str=code_block_13, searchFor=code_block_20, replaceWith=list_create)  # package Clockwork for Dynamo 2.x; Replaces multiple search terms in a given string with multiple replacements
code_block_21 = CodeBlock { "##ADDDATE##"; }
replace_3 = String.Replace(str=replaceMultiple, searchFor=code_block_21, replaceWith=code_block_19.dateChunk)

# group: Firing the requesto to Notion Api
byUrl_2 = DynaWeb.WebRequest.ByUrl(url=code_block_10)
code_block_22 = CodeBlock(NotionSecret=code_block_5.b) { "Authorization"; "Bearer "+NotionSecret; }
addHeader = DynaWeb.WebRequest.AddHeader(webRequest=byUrl_2, name=code_block_22.out0, value=code_block_22.out1)
code_block_23 = CodeBlock { "POST"; }
setMethod_2 = DynaWeb.WebRequest.SetMethod(webRequest=addHeader, method=code_block_23)
code_block_24 = CodeBlock { "Notion-Version"; "2021-08-16"; }
addHeader_2 = DynaWeb.WebRequest.AddHeader(webRequest=setMethod_2, name=code_block_24.out0, value=code_block_24.out1)
code_block_25 = CodeBlock { "JSON"; }
setRequestFormat = DynaWeb.WebRequest.SetRequestFormat(webRequest=addHeader_2, format=code_block_25)
string_3 = StringInput("application/json")
string_4 = StringInput("RequestBody")
addParameter_2 = DynaWeb.WebRequest.AddParameter(webRequest=setRequestFormat, name=string_3, value=replace_3, parameterType=string_4)
execute_2 = DynaWeb.WebRequest.Execute(request=addParameter_2)

statusCode = DynaWeb.WebResponse.StatusCode(webResponse=execute_2)

# group: We're done so we can delete the Active View image in the model directory
code_block_26 = CodeBlock(a=code_block_3, b=statusCode) { [a,b][0]; }
deleteFile = FileSystem.DeleteFile(path=code_block_26)
