# Dynamo graph RevitToSVG.dyn (Dynamo 2.0.3.8810)

# group: Packages
# note: Clockwork v.2.1.2
# spring nodes v.121.0.2

# group: Input
# note: Files destination folder
directory_path = Directory("C:\Dropbox\Architettura\00 - Research\32 - ROOM TO POWER BY SVG")
# note: Level to get the room from
levels = Levels(index=0)
# note: Curve segmentation lenght
code_block = CodeBlock()
# ---------- code_block.designscript (4 lines) ----------
//Lenght of the steps on which
//an arc is simplified into a line
//(it uses the project lenght units)
20;
# ----------------------------------------
# note: Parameter values to export
code_block_2 = CodeBlock()
# ---------- code_block_2.designscript (11 lines) ----------
[
"Area",
"Perimeter",
"Department",
"Name",
"Number",
"Base Finish",
"Ceiling Finish",
"Wall Finish",
"Floor Finish"
];
# ----------------------------------------

# group: File paths and timestamps
code_block_3 = CodeBlock(a=directory_path) { a; }
current = Document.Current()
filePath = Document.FilePath(document=current)
code_block_4 = CodeBlock { false; }
fileName = FileSystem.FileName(path=filePath, withExtension=code_block_4)
now = DateTime.Now()
code_block_5 = CodeBlock { "yyy-MM-dd-HH-mm-ss"; }
format = DateTime.Format(dateTime=now, format=code_block_5)
code_block_6 = CodeBlock(fn=fileName, ts=format) { fn+"-"+ts; }
code_block_7 = CodeBlock(a=code_block_3, b=code_block_6) { a; b; }

code_block_8 = CodeBlock(a=code_block_7.a, b=code_block_7.b) { a; b; }

# group: Final file paths
code_block_9 = CodeBlock(a=code_block_8.a, fn=code_block_8.b) { a+"\\"+fn+"_SHAPES.svg"; a+"\\"+fn+"_DATA.xlsx"; }

# group: Gathering all valid Rooms
all_elements_at_level = ElementsAtLevel(Level=levels)
# note: Custom Node: Clockwork v.2.1.2
category = Custom[Element.Category+](element=all_elements_at_level)  # Returns the category of a given element. Unlike the OOTB node Element.GetCategory, it will work for subcategories, families, family documents, schedules, subcategories and graphics styles as well.
string_from_object = FromObject(obj=category)
code_block_10 = CodeBlock(a=string_from_object) { a=="Rooms"; }
filterByBoolMask = List.FilterByBoolMask(list=all_elements_at_level, mask=code_block_10)
code_block_11 = CodeBlock(a=filterByBoolMask.in) { a; }
area = Room.Area(room=code_block_11)
code_block_12 = CodeBlock(a=area) { a!=0; }
filterByBoolMask_2 = List.FilterByBoolMask(list=code_block_11, mask=code_block_12)

# group: Extracting boundaries and getting just the biggest patch for each room
# note: Custom Node: Clockwork v.2.1.2
boundaries = Custom[Room.Boundaries](room=filterByBoolMask_2.in)  # Gets a list of all boundaries of a given room or area and a corresponding list of the elements that are generating those boundaries.
group_curves = Custom[Group Curves](Curves=boundaries.curves@L2)  # This node will take any input of flat list of curves and group them into sublists containing "joinable" curves that is continous curves. They might form closed curves or open curves. Use PolyCurve.ByJoinedCurves to convert output groups of curves into single PolyCurves
byJoinedCurves = PolyCurve.ByJoinedCurves(curves=group_curves)
byPatch = Surface.ByPatch(closedCurve=byJoinedCurves)
area_2 = Surface.Area(surface=byPatch)
sortByKey = List.SortByKey(list=group_curves@L3, keys=area_2@L2)
reverse = List.Reverse(list=sortByKey.sorted_list@L3)
firstItem = List.FirstItem(list=reverse@L3)

code_block_13 = CodeBlock(a=code_block) { a; }

# group: Segmenting curves when needed
code_block_14 = CodeBlock(a=firstItem) { a; }
type = Object.Type(obj=code_block_14)
code_block_15 = CodeBlock(a=type) { a!="Autodesk.DesignScript.Geometry.Line"; }
length = Curve.Length(curve=code_block_14)
code_block_16 = CodeBlock(a=code_block_13) { a; }
code_block_17 = CodeBlock(a=length, segtr=code_block_16) { a/segtr; }
ceiling = Math.Ceiling(number=code_block_17)
code_block_18 = CodeBlock(a=code_block_15, ce=ceiling) { a?ce:2; }
code_block_19 = CodeBlock(x=code_block_18) { 0..1..#x; }
pointAtParameter = Curve.PointAtParameter(curve=code_block_14@L1, param=code_block_19@L2)
count = List.Count(list=code_block_14@L2)
chop = List.Chop(list=pointAtParameter, lengths=count)
flatten = List.Flatten(list=chop@L3)
pruneDuplicates = Point.PruneDuplicates(points=flatten)

# group: Moving everything to have all point starting from 0,0,0 to up and left
code_block_20 = CodeBlock(a=pruneDuplicates) { a; }
flatten_2 = List.Flatten(list=code_block_20)
# note: Custom Node: spring nodes v.121.0.2
convexHull2D = Custom[Springs.Points.ConvexHull2D](points=flatten_2)  # Computes the XY convex hull of a given set of points based on the monotone chain algorithm.
code_block_21 = CodeBlock { true; }
byPoints = PolyCurve.ByPoints(points=convexHull2D, connectLastToFirst=code_block_21)
boundingBox = Geometry.BoundingBox(geometry=byPoints)
XY = Plane.XY()
# note: Custom Node: Clockwork v.2.1.2
perimeterCurvesOnPlane = Custom[BoundingBox.PerimeterCurvesOnPlane](boundingbox=boundingBox, plane=XY)  # Returns the perimeter curve of a bounding box on a given plane (assuming that the bounding box and plane intersect)
startPoint = Curve.StartPoint(curve=perimeterCurvesOnPlane)
X = Point.X(point=startPoint)
minimumItem = List.MinimumItem(list=X)
Y = Point.Y(point=startPoint)
minimumItem_2 = List.MinimumItem(list=Y)
byCoordinates = Point.ByCoordinates(x=minimumItem, y=minimumItem_2)
byCoordinates_2 = Point.ByCoordinates()
byTwoPoints = Vector.ByTwoPoints(start=byCoordinates, end=byCoordinates_2)
firstItem_2 = List.FirstItem(list=byTwoPoints)
translate = Geometry.Translate(geometry=code_block_20, direction=firstItem_2)

# group: Formatting coordinates like in the svg schema
code_block_22 = CodeBlock(a=translate) { a; }
X_2 = Point.X(point=code_block_22)
flatten_3 = List.Flatten(list=X_2)
maximumItem = List.MaximumItem(list=flatten_3)
Y_2 = Point.Y(point=code_block_22)
flatten_4 = List.Flatten(list=Y_2)
maximumItem_2 = List.MaximumItem(list=flatten_4)
code_block_23 = CodeBlock { 1080; }
code_block_24 = CodeBlock(a=maximumItem, b=maximumItem_2, x=code_block_23) { (a/b)*x; }
floor = Math.Floor(number=code_block_24)
string_from_object_2 = FromObject(obj=floor)
string_from_object_3 = FromObject(obj=code_block_23)
flatten_5 = List.Flatten(list=X_2)
code_block_25 = CodeBlock { 0; }
remapRange = Math.RemapRange(numbers=flatten_5, newMin=code_block_25, newMax=floor)
flatten_6 = List.Flatten(list=Y_2)
maximumItem_3 = List.MaximumItem(list=flatten_6)
code_block_26 = CodeBlock(a=maximumItem_3, b=Y_2) { a-b; }
count_2 = List.Count(list=code_block_26@L2)
code_block_27 = CodeBlock(a=count_2) { a; }
chop_2 = List.Chop(list=remapRange, lengths=code_block_27)
floor_2 = Math.Floor(number=chop_2)
flatten_7 = List.Flatten(list=code_block_26)
remapRange_2 = Math.RemapRange(numbers=flatten_7, newMin=code_block_25, newMax=code_block_23)
chop_3 = List.Chop(list=remapRange_2, lengths=code_block_27)
floor_3 = Math.Floor(number=chop_3)
code_block_28 = CodeBlock(a=floor_2, b=floor_3) { a+","+b; }

# group: SVG header
string = StringInput("<svg version=\"1.1\" id=\"Map\" class=\"gen-by-synoptic-designer\" xmlns=\"http://www.w3.org/2000/svg\" xmlns:xlink=\"http://www.w3.org/1999/xlink\" viewBox=\"0 0 #X# #Y#\" xml:space=\"preserve\">")
code_block_29 = CodeBlock { "#X#"; "#Y#"; }
replace = String.Replace(str=string, searchFor=code_block_29.out0, replaceWith=string_from_object_2)
replace_2 = String.Replace(str=replace, searchFor=code_block_29.out1, replaceWith=string_from_object_3)

code_block_30 = CodeBlock(a=code_block_2) { a; }

# group: Extracting relevant rooms data
code_block_31 = CodeBlock(a=filterByBoolMask_2.in) { a; }
id = Element.Id(element=code_block_31)
getParameterValueByName = Element.GetParameterValueByName(element=code_block_31@L1, parameterName=code_block_30)
addItemToFront = List.AddItemToFront(item=id@L1, list=getParameterValueByName@L2)
code_block_32 = CodeBlock { "ID"; }
addItemToFront_2 = List.AddItemToFront(item=code_block_32, list=code_block_30)
code_block_33 = CodeBlock(a=id, b=addItemToFront, c=addItemToFront_2) { a; b; c; }

# group: Dressing up data to go in the SVG and XLSX
code_block_34 = CodeBlock(a=code_block_33.a, b=code_block_33.b, c=code_block_33.c) { a; b; c; DSCore.List.Flatten([[c],b],1); }
code_block_35 = CodeBlock { 4; }
getItemAtIndex = List.GetItemAtIndex(list=code_block_34.b@L2, index=code_block_35)

# group: Making polygons paths rows
code_block_36 = CodeBlock { ","; }
join = String.Join(separator=code_block_36, string0=code_block_28)
flatten_8 = List.Flatten(list=join)
code_block_37 = CodeBlock(id=code_block_34.a, tl=getItemAtIndex, str=flatten_8) { "<polygon id=\""+id+"\" title=\""+tl+"\" points=\""+str+"\" />"; }

# group: Putting everything together and forming the final text
code_block_38 = CodeBlock { "\n"; }
string_2 = StringInput("</svg>")
list_create = List.Create(item0=replace_2, item1=code_block_37, item2=string_2)
flatten_9 = List.Flatten(list=list_create)
join_2 = String.Join(separator=code_block_38, string0=flatten_9)

# group: writing sweet files
writeText = FileSystem.WriteText(filePath=code_block_9.out0, text=join_2)
code_block_39 = CodeBlock { 0; "Sheet1"; }
exportExcel = Data.ExportExcel(filePath=code_block_9.out1, sheetName=code_block_39.out1, startRow=code_block_39.out0, startCol=code_block_39.out0, data=code_block_34.out3)

code_block_40 = CodeBlock {  }
