# Dynamo graph ShortKeys To Carnac yml.dyn (Dynamo 2.0.4.12684)

# group: Packages
# note: JsonData v.2.0.2
# Clockwork v.1.0.3

# group: Inputs
carnac_keymaps_folder = Directory("C:\Users\Pierpaolo\AppData\Local\carnac\app-2.3.13\Keymaps")  # graph input
keybordshortcut_file = Filename(".\KeyboardShortcuts.xml")  # graph input

code_block = CodeBlock(a=carnac_keymaps_folder) { a; }

# group: Parsing the KeyboardShortcut file
fromXMLFile = JsonData.Utilities.Read.FromXMLFile(filepath=keybordshortcut_file)
code_block_2 = CodeBlock { "Shortcuts"; }
getValueByKey = JsonObject.GetValueByKey(jsonObject=fromXMLFile, keys=code_block_2, Nesting=true, Option="None")
code_block_3 = CodeBlock { "ShortcutItem"; }
getValueByKey_2 = JsonObject.GetValueByKey(jsonObject=getValueByKey, keys=code_block_3, Nesting=true, Option="None")
code_block_4 = CodeBlock { "@CommandName"; }
getValueByKey_3 = JsonObject.GetValueByKey(jsonObject=getValueByKey_2, keys=code_block_4, Nesting=true, Option="None")
code_block_5 = CodeBlock { "@Shortcuts"; }
getValueByKey_4 = JsonObject.GetValueByKey(jsonObject=getValueByKey_2, keys=code_block_5, Nesting=true, Option="None")

# group: Cleaning unassigned commands
isNull = Object.IsNull(obj=getValueByKey_4)
not_ = Not(x=isNull)
filterByBoolMask = List.FilterByBoolMask(list=getValueByKey_3, mask=not_)
filterByBoolMask_2 = List.FilterByBoolMask(list=getValueByKey_4, mask=not_)

# group: Duplicating records for commands with multiple shortcuts
code_block_6 = CodeBlock { "#"; }
split = String.Split(str=filterByBoolMask_2.in, separater0=code_block_6)
count = List.Count(list=split@L2)
ofRepeatedItem = List.OfRepeatedItem(item=filterByBoolMask.in@L1, amount=count@L1)

# group: Replacing ":". It's no good
flatten = List.Flatten(list=ofRepeatedItem)
code_block_7 = CodeBlock { ":"; "|"; }
replace = String.Replace(str=flatten, searchFor=code_block_7.out0, replaceWith=code_block_7.out1)
flatten_2 = List.Flatten(list=split)

# group: Breaking up shortcuts with multiplie contextual commands. we need just one
string = StringInput("; ")
split_2 = String.Split(str=replace, separater0=string)
firstItem = List.FirstItem(list=split_2@L2)

# group: Processing keystrokes strings
python_script = Python(IN[0]=flatten_2)
# ---------- python_script.python (21 lines) ----------
# Enable Python support and load DesignScript library
import clr
clr.AddReference('ProtoGeometry')
from Autodesk.DesignScript.Geometry import *

# The inputs to this node will be stored as a list in the IN variables.
str = IN[0]

result= []

for s in str:
	if "+" in s:
		result.append(s)
	else:
		char = []
		for c in s:
			char.append(c)
		result.append(",".join(char))


OUT = result
# ----------------------------------------

# group: Tossing out some edge cases: one keystroke shortcuts, ambiguous shortcuts...
length = String.Length(str=python_script)
code_block_8 = CodeBlock(a=length) { a>1; }
filterByBoolMask_3 = List.FilterByBoolMask(list=firstItem, mask=code_block_8)
filterByBoolMask_4 = List.FilterByBoolMask(list=python_script, mask=code_block_8)
python_script_2 = Python(IN[0]=filterByBoolMask_4.in)
# ---------- python_script_2.python (20 lines) ----------
# Enable Python support and load DesignScript library
import clr
clr.AddReference('ProtoGeometry')
from Autodesk.DesignScript.Geometry import *

# The inputs to this node will be stored as a list in the IN variables.
str = IN[0]
result = []


for s in str:
	boo = True
	for s2 in str:
		if s2.startswith(s) and len(s)<len(s2):
			boo = False
	result.append(boo)



OUT = result
# ----------------------------------------
filterByBoolMask_5 = List.FilterByBoolMask(list=filterByBoolMask_3.in, mask=python_script_2)
filterByBoolMask_6 = List.FilterByBoolMask(list=filterByBoolMask_4.in, mask=python_script_2)

# group: Concatenating the yml content
code_block_9 = CodeBlock { "\n"; }
string_2 = StringInput("""group:          revit
process:        Revit

shortcuts:""")
string_3 = StringInput("""    - name: #CMD#
      keys:
      - #KSK#""")
code_block_10 = CodeBlock { "#CMD#"; }
replaceMultiple = Custom[String.ReplaceMultiple](str=string_3, searchFor=code_block_10, replaceWith=filterByBoolMask_5.in@L1)  # Replaces multiple search terms in a given string with multiple replacements
code_block_11 = CodeBlock { "#KSK#"; }
replaceMultiple_2 = Custom[String.ReplaceMultiple](str=replaceMultiple@L1, searchFor=code_block_11, replaceWith=filterByBoolMask_6.in@L1)
join = List.Join(list0=string_2, list1=replaceMultiple_2)
flatten_3 = List.Flatten(list=join)
join_2 = String.Join(separator=code_block_9, string0=flatten_3)
firstItem_2 = List.FirstItem(list=join_2)

# group: Wrtiting the file
code_block_12 = CodeBlock(a=code_block) { a+"\\revit.yml"; }
writeText = FileSystem.WriteText(filePath=code_block_12, text=firstItem_2)
