# Dynamo graph myAwesomeAxon.dyn (Dynamo 2.3.0.5885)
# packages: Clockwork for Dynamo 2.x 2.3.0, Rhythm 2020.9.8, Genius Loci 2020.4.29, Data-Shapes 2021.2.3

# group: Packages
# note: Clockwork for Dynamo 2.x v2.1.2
# Genius Loci v2019.9.04
# Data-Shapes v2019.2.27
# Rhythm v2020.2.13

boolean = BoolSelector(true)

# group: Get the active view
current = Document.Current()
code_block = CodeBlock(a=current, b=boolean) { [a,b][0]; }
activeView = Document.ActiveView(document=code_block)

# group: Gets the view orientation, eyePoint and Target
plane = Custom[View.Plane](view=activeView)  # package Clockwork for Dynamo 2.x; Retrieves the plane of a given view
origin = Plane.Origin(plane=plane)
normal = Plane.Normal(plane=plane)
reverse = Vector.Reverse(vector=normal)
translate = Geometry.Translate(geometry=origin, direction=reverse)

code_block_2 = CodeBlock(a=origin) { a; }
code_block_3 = CodeBlock(a=translate) { a; }

# group: Get the scope boxes
code_block_4 = CodeBlock { "Scope Boxes"; }
code_block_5 = CodeBlock(a=code_block_4, b=boolean) { [a,b][0]; }
byName = Category.ByName(name=code_block_5)
selectByCategoryAndView = Custom[SelectByCategoryAndView](view=activeView, category=byName)  # package Genius Loci; Collects elements by Category and View in the active or given document.
name = Custom[Element.Name+](element=selectByCategoryAndView)  # package Clockwork for Dynamo 2.x; Gets an element's name. Unlike the OOTB node, this node should work for all Revit elements that have names and will also return the localized names of system parameters, parameter groups, display unit types, parameter types, unit symbol types and unit types.
code_block_6 = CodeBlock { "CONTAINER"; "SECTION"; }
allIndicesOf = List.AllIndicesOf(list=name, item=code_block_6.out0)
getItemAtIndex = List.GetItemAtIndex(list=selectByCategoryAndView, index=allIndicesOf)
allIndicesOf_2 = List.AllIndicesOf(list=name, item=code_block_6.out1)
getItemAtIndex_2 = List.GetItemAtIndex(list=selectByCategoryAndView, index=allIndicesOf_2)

# group: Gets the bounding boxes cuboids, points and stuff
boundingBox = Element.BoundingBox(element=getItemAtIndex)
minPoint = BoundingBox.MinPoint(boundingBox=boundingBox)
boundingBox_2 = Element.BoundingBox(element=getItemAtIndex_2)
toCuboid = BoundingBox.ToCuboid(boundingBox=boundingBox_2)
maxPoint = BoundingBox.MaxPoint(boundingBox=boundingBox)

# group: Gets the top and bottom surface f the SECTION scope box
explode = Geometry.Explode(geometry=toCuboid)
code_block_7 = CodeBlock { 0.5; }
pointAtParameter = Surface.PointAtParameter(surface=explode, u=code_block_7, v=code_block_7)
normalAtParameter = Surface.NormalAtParameter(surface=explode, u=code_block_7, v=code_block_7)
ZAxis = Vector.ZAxis()
isParallel = Vector.IsParallel(vector=normalAtParameter, other=ZAxis)
filterByBoolMask = List.FilterByBoolMask(list=pointAtParameter@L2, mask=isParallel@L2)
filterByBoolMask_2 = List.FilterByBoolMask(list=explode@L2, mask=isParallel@L2)

# group: Does som geometry and math to get the dimensions of the middle sectors in the stack
list_create = List.Create(item0=minPoint, item1=filterByBoolMask.in)
code_block_8 = CodeBlock { 3; }
normalizeDepth = List.NormalizeDepth(list=list_create, rank=code_block_8)
ZAxis_2 = Vector.ZAxis()
byOriginNormal = Plane.ByOriginNormal(origin=normalizeDepth, normal=ZAxis_2)
perimeterCurvesOnPlane = Custom[BoundingBox.PerimeterCurvesOnPlane](boundingbox=boundingBox@L1, plane=byOriginNormal)  # package Clockwork for Dynamo 2.x; Returns the perimeter curve of a bounding box on a given plane (assuming that the bounding box and plane intersect)
byJoinedCurves = PolyCurve.ByJoinedCurves(curves=perimeterCurvesOnPlane)
flatten = List.Flatten(list=byJoinedCurves@L3)
byPatch = Surface.ByPatch(closedCurve=flatten)
code_block_9 = CodeBlock(a=byPatch) { a[0]; }
code_block_10 = CodeBlock { 0.5; }
pointAtParameter_2 = Surface.PointAtParameter(surface=byPatch, u=code_block_10, v=code_block_10)
Z = Point.Z(point=pointAtParameter_2)
minimumItem = List.MinimumItem(list=Z@L2)
code_block_11 = CodeBlock(a=minimumItem) { a[1]-a[0]; }
code_block_12 = CodeBlock(a=code_block_9, b=code_block_11) { a; b; }
code_block_13 = CodeBlock(a=byPatch) { a; }
code_block_14 = CodeBlock(a=pointAtParameter_2) { a[1]; }
Z_2 = Point.Z(point=code_block_14)
minimumItem_2 = List.MinimumItem(list=Z_2)
allIndicesOf_3 = List.AllIndicesOf(list=Z@L2, item=minimumItem_2)
getItemAtIndex_3 = List.GetItemAtIndex(list=code_block_13@L2, index=allIndicesOf_3@L2)
Z_3 = Point.Z(point=maxPoint)

# group: Sorts the faces, the top one and the lower one
Z_4 = Point.Z(point=filterByBoolMask.in)
minimumItem_3 = List.MinimumItem(list=Z_4)
indexOf = List.IndexOf(list=Z_4@L2, element=minimumItem_3)
getItemAtIndex_4 = List.GetItemAtIndex(list=filterByBoolMask_2.in@L2, index=indexOf@L2)
maximumItem = List.MaximumItem(list=Z_4)
code_block_15 = CodeBlock(a=maximumItem, b=minimumItem_3) { a-b; }
code_block_16 = CodeBlock(a=code_block_15) { a; }
code_block_17 = CodeBlock(a=filterByBoolMask.in) { a; }
getItemAtIndex_5 = List.GetItemAtIndex(list=code_block_17@L2, index=indexOf@L2)

# group: Creates the grid to split the CONTAINER scope box into sectors according to the position of the SECTION scope box
edges = Topology.Edges(topology=getItemAtIndex_4)
curveGeometry = Edge.CurveGeometry(edge=edges)
code_block_18 = CodeBlock { 0.5; }
pointAtParameter_3 = Curve.PointAtParameter(curve=curveGeometry, param=code_block_18)
ZAxis_3 = Vector.ZAxis()
byOriginNormal_2 = Plane.ByOriginNormal(origin=pointAtParameter_3, normal=ZAxis_3)
code_block_19 = CodeBlock { 10; }
scale = Geometry.Scale(geometry=curveGeometry, plane=byOriginNormal_2, xamount=code_block_19, yamount=code_block_19)
startPoint = Curve.StartPoint(curve=scale)
endPoint = Curve.EndPoint(curve=scale)
byStartPointEndPoint = Line.ByStartPointEndPoint(startPoint=startPoint, endPoint=endPoint)
code_block_20 = CodeBlock { 0; }
tangentAtParameter = Curve.TangentAtParameter(curve=byStartPointEndPoint, param=code_block_20)
XAxis = Vector.XAxis()
isParallel_2 = Vector.IsParallel(vector=tangentAtParameter, other=XAxis)
groupByKey = List.GroupByKey(list=byStartPointEndPoint@L2, keys=isParallel_2@L2)
ZAxis_4 = Vector.ZAxis()
code_block_21 = CodeBlock { 1000; }
extrude = Curve.Extrude(curve=groupByKey.groups, direction=ZAxis_4, distance=code_block_21)
reverse_2 = Vector.Reverse(vector=ZAxis_4)
code_block_22 = CodeBlock(a=code_block_21) { a/2; }
translate_2 = Geometry.Translate(geometry=extrude, direction=reverse_2, distance=code_block_22)
byJoinedSurfaces = PolySurface.ByJoinedSurfaces(surfaces=translate_2)
code_block_23 = CodeBlock(a=byJoinedSurfaces) { a[0][0]; a[0][1]; }

# group: Splits the CONTANER horizontal face into sectors and extract the boundaries curves
code_block_24 = CodeBlock(a=code_block_12.a, b=code_block_12.b) { a; b; }
edges_2 = Topology.Edges(topology=code_block_24.a)
curveGeometry_2 = Edge.CurveGeometry(edge=edges_2)
byJoinedCurves_2 = PolyCurve.ByJoinedCurves(curves=curveGeometry_2)
split = Geometry.Split(geometry=getItemAtIndex_3@L1, other=code_block_23.out0)
split_2 = Geometry.Split(geometry=split@L1, other=code_block_23.out1)
edges_3 = Topology.Edges(topology=split_2)
curveGeometry_3 = Edge.CurveGeometry(edge=edges_3)
byJoinedCurves_3 = PolyCurve.ByJoinedCurves(curves=curveGeometry_3)

firstItem = List.FirstItem(list=code_block_16)
code_block_25 = CodeBlock(a=getItemAtIndex_5) { a; }
code_block_26 = CodeBlock(a=firstItem) { a/2; }
code_block_27 = CodeBlock(a=Z) { a[1]; }

# group: Gets the sizes of the top sector of the stack
code_block_28 = CodeBlock(a=code_block_13) { a[1]; }
flatten_2 = List.Flatten(list=allIndicesOf_3)
removeItemAtIndex = List.RemoveItemAtIndex(list=code_block_28, indices=flatten_2)
removeItemAtIndex_2 = List.RemoveItemAtIndex(list=code_block_27, indices=flatten_2)
code_block_29 = CodeBlock(a=Z_3, b=removeItemAtIndex_2) { a-b; }

# group: Extracts the boundaries curves
edges_4 = Topology.Edges(topology=removeItemAtIndex)
curveGeometry_4 = Edge.CurveGeometry(edge=edges_4)
byJoinedCurves_4 = PolyCurve.ByJoinedCurves(curves=curveGeometry_4)

# group: Extrude all the sectors cuboids
ZAxis_5 = Vector.ZAxis()
extrudeAsSolid = Curve.ExtrudeAsSolid(curve=byJoinedCurves_2, direction=ZAxis_5, distance=code_block_24.b)
extrudeAsSolid_2 = Curve.ExtrudeAsSolid(curve=byJoinedCurves_3, direction=ZAxis_5, distance=firstItem)
extrudeAsSolid_3 = Curve.ExtrudeAsSolid(curve=byJoinedCurves_4, direction=ZAxis_5, distance=code_block_29)

code_block_30 = CodeBlock(a=extrudeAsSolid) { a; }
translate_3 = Geometry.Translate(geometry=code_block_25, direction=ZAxis_5, distance=code_block_26)

# group: Finds the "Cut" sector
doesIntersect = Geometry.DoesIntersect(geometry=translate_3@L1, other=extrudeAsSolid_2)
code_block_31 = CodeBlock { true; }
allIndicesOf_4 = List.AllIndicesOf(list=doesIntersect@L2, item=code_block_31)
removeItemAtIndex_3 = List.RemoveItemAtIndex(list=extrudeAsSolid_2@L2, indices=allIndicesOf_4@L2)
getItemAtIndex_6 = List.GetItemAtIndex(list=extrudeAsSolid_2@L2, index=allIndicesOf_4@L2)

code_block_32 = CodeBlock(a=extrudeAsSolid_3) { a; }
list_create_2 = List.Create(item0=code_block_30, item1=removeItemAtIndex_3, item2=getItemAtIndex_6, item3=code_block_32)

# group: Creates all sectors temporary names and boundingboxes
flatten_3 = List.Flatten(list=list_create_2@L3)
count = List.Count(list=flatten_3@L2)
code_block_33 = CodeBlock(a=count) { b=a[0]; f=a[1]; c=a[2]; d=a[3]; "AXON_BASE_"+(1..b); "AXON_FILLER_"+(1..f); "AXON_CUT_"+(1..c); "AXON_UPPER_"+(1..c); }
byGeometry = BoundingBox.ByGeometry(geom=flatten_3@L1)
chop = List.Chop(list=byGeometry, lengths=count)
code_block_34 = CodeBlock(a=chop) { a[0]; a[1]; a[3]; }

code_block_35 = CodeBlock(b=code_block_33.out4, f=code_block_33.out5, c=code_block_33.out6, u=code_block_33.out7) { b; f; c; u; }
code_block_36 = CodeBlock(b=code_block_35.b, f=code_block_35.f, c=code_block_35.c, u=code_block_35.u) { b; f; c; u; }

# group: Checks witch sectors are empty
builtInCategories = Custom[Document.BuiltInCategories]()  # package Clockwork for Dynamo 2.x; List all the available BuiltInCategories
type = Custom[Category.Type](category=builtInCategories.Categories)  # package Clockwork for Dynamo 2.x; Returns the type of the category
code_block_37 = CodeBlock(a=type) { a=="Model"; }
filterByBoolMask_3 = List.FilterByBoolMask(list=builtInCategories.Categories, mask=code_block_37)
selectByCategoryAndBoundingBox = Custom[SelectByCategoryAndBoundingBox](category=filterByBoolMask_3.in, boundingBox=code_block_34.out1@L1)  # package Genius Loci; Collect elements by category from a BoundingBox.
isEmpty = List.IsEmpty(list=selectByCategoryAndBoundingBox@L2)
code_block_38 = CodeBlock { true; }
allIndicesOf_5 = List.AllIndicesOf(list=isEmpty, item=code_block_38)

code_block_39 = CodeBlock(b=code_block_34.out0, f=code_block_34.out1, u=code_block_34.out2) { b; f; u; }

# group: Finds the bounding mix mid point
minPoint_2 = BoundingBox.MinPoint(boundingBox=code_block_34.out1)
maxPoint_2 = BoundingBox.MaxPoint(boundingBox=code_block_34.out1)
byStartPointEndPoint_2 = Line.ByStartPointEndPoint(startPoint=minPoint_2, endPoint=maxPoint_2)
code_block_40 = CodeBlock { 0.5; }
pointAtParameter_4 = Curve.PointAtParameter(curve=byStartPointEndPoint_2, param=code_block_40)

# group: Removes all empty sectors
removeItemAtIndex_4 = List.RemoveItemAtIndex(list=code_block_35.f, indices=allIndicesOf_5)
removeItemAtIndex_5 = List.RemoveItemAtIndex(list=code_block_39.f, indices=allIndicesOf_5)
removeItemAtIndex_6 = List.RemoveItemAtIndex(list=pointAtParameter_4, indices=allIndicesOf_5)

code_block_41 = CodeBlock(b=code_block_36.b, f=removeItemAtIndex_4, u=code_block_36.u) { [b,f,u]; }
flatten_4 = List.Flatten(list=code_block_41)

# group: Sorts the bounding boxes according to the distance to the eyePoint. Gratest distance on top, smallest on the bottom of the list
code_block_42 = CodeBlock(b=code_block_39.b, f=code_block_39.f, u=code_block_39.u) { b; f; u; }
distanceTo = Geometry.DistanceTo(geometry=removeItemAtIndex_6, other=code_block_2)
sortByKey = List.SortByKey(list=removeItemAtIndex_5, keys=distanceTo)
reverse_3 = List.Reverse(list=sortByKey.sorted_list@L2)
code_block_43 = CodeBlock(b=code_block_42.b, f=reverse_3, u=code_block_42.u) { [b,f,u]; }
flatten_5 = List.Flatten(list=code_block_43)

# group: Clears nulls
isNull = Object.IsNull(obj=flatten_5)
code_block_44 = CodeBlock { true; }
allIndicesOf_6 = List.AllIndicesOf(list=isNull, item=code_block_44)
removeItemAtIndex_7 = List.RemoveItemAtIndex(list=flatten_4, indices=allIndicesOf_6)
removeItemAtIndex_8 = List.RemoveItemAtIndex(list=flatten_5, indices=allIndicesOf_6)

# group: Makes new axons
byEyePointAndTarget = AxonometricView.ByEyePointAndTarget(eyePoint=code_block_2, target=code_block_3, name=removeItemAtIndex_7)

# group: Checks old awesome axon numbers and creates the new one
code_block_45 = CodeBlock { "AAX_"; }
code_block_46 = CodeBlock { "Views"; }
code_block_47 = CodeBlock(a=code_block_46, b=boolean) { [a,b][0]; }
byName_2 = Category.ByName(name=code_block_47)
all_elements_of_category = ElementsOfCategory(Category=byName_2)
code_block_48 = CodeBlock { false; }
clean = List.Clean(list=all_elements_of_category, preserveIndices=code_block_48)
name_2 = Custom[Element.Name+](element=clean)
startsWith = String.StartsWith(str=name_2, searchFor=code_block_45)
allFalse = List.AllFalse(list=startsWith)
python_script = Python(IN[0]=allFalse, IN[1]=name_2, IN[2]=code_block_45)
# ---------- python_script.python (23 lines) ----------
# Enable Python support and load DesignScript library
import clr
clr.AddReference('ProtoGeometry')
from Autodesk.DesignScript.Geometry import *

# The inputs to this node will be stored as a list in the IN variables.
test = IN[0]
names = IN[1]
pref = IN[2]

o=""

if test:
	o= 0
else:
	splits=[]
	for name in names:
		if name.startswith(pref):
			splitted=name.split("_")
			splits.append(int(splitted[1]))
	o=splits

OUT = o
# ----------------------------------------
maximumItem_2 = List.MaximumItem(list=python_script)
code_block_49 = CodeBlock(a=maximumItem_2) { a+1; }
string_from_object = FromObject(obj=code_block_49)
code_block_50 = CodeBlock { "."; }
split_3 = String.Split(str=string_from_object, separator0=code_block_50)
firstItem_2 = List.FirstItem(list=split_3@L2)
code_block_51 = CodeBlock { 3; "0"; }
padLeft = String.PadLeft(str=firstItem_2, newWidth=code_block_51.out0, padChars=code_block_51.out1)
firstItem_3 = List.FirstItem(list=padLeft)

# group: UI
code_block_52 = CodeBlock { "Awesome Axon"; }
code_block_53 = CodeBlock { lg; "Do It!"; "Cancel"; }  # unwired: lg
string = StringInput("""INSTRUCTIONS

1 - Set two scope boxes one called "CONTAINER" the other called "SECTION". Stretch COINTAINER to contain everything you want in your Axonometric View and then stretch SECTION according to the cut you want. 
SECTION must be completely inside CONTAINER

2 - Run the script from the 3D view. The script will use that point of view to make your brand new AwesomeAxon. After having run the script you can delete the scope boxes if you need to.

it works for axononometric views, but you could try something funny ;)

Packages you need:
Clockwork for Dynamo 2.x v2.1.2
Genius Loci v2019.9.04
Data-Shapes v2019.2.27
Rhythm v2020.2.13""")
ui_textnote_data = Custom[UI.TextNote Data](TextNote=string)  # package Data-Shapes; Create Data for TextNote input in UI.MultipleInputForm ++ . Check out www.data-shapes.net for more informations
code_block_54 = CodeBlock { "Sheet where you want your AwesomeAxon"; }
code_block_55 = CodeBlock { "Sheets"; }
code_block_56 = CodeBlock(a=code_block_55, b=boolean) { [a,b][0]; }
byName_3 = Category.ByName(name=code_block_56)
all_elements_of_category_2 = ElementsOfCategory(Category=byName_3)
sheetNumber = Sheet.SheetNumber(sheet=all_elements_of_category_2)
sheetName = Sheet.SheetName(sheet=all_elements_of_category_2)
code_block_57 = CodeBlock(a=sheetNumber, b=sheetName) { a+" - "+b; }
code_block_58 = CodeBlock { 0; }
ui_dropdown_data = Custom[UI.DropDown Data](InputName=code_block_54, Keys=code_block_57, Values=all_elements_of_category_2, DefaultValueIndex=code_block_58)  # package Data-Shapes; Create data for DropDown input in UI.MultiInputForm ++ . Check out www.data-shapes.net for more infos.
code_block_59 = CodeBlock { "View Custom Name"; "myAwesomeAxon"; }
ui_textbox_data = Custom[UI.TextBox Data](InputName=code_block_59.out0, DefaultText=code_block_59.out1)  # package Data-Shapes; Create Data for TextBox input in UI.MultipleInputForm ++ . Check out www.data-shapes.net for more informations
code_block_60 = CodeBlock { "View Template Name"; }
python_script_2 = Python()  # unwired: IN[0]
# ---------- python_script_2.python (9 lines) ----------
import clr
clr.AddReference('RevitAPI')
from Autodesk.Revit.DB import*
clr.AddReference('RevitServices')
from RevitServices.Persistence import DocumentManager
doc = DocumentManager.Instance.CurrentDBDocument

tempnames = [v.Name for v in FilteredElementCollector(doc).OfClass(View).ToElements() if v.IsTemplate and v.ViewType == ViewType.ThreeD]
OUT = tempnames
# ----------------------------------------
code_block_61 = CodeBlock { 0; }
ui_dropdown_data_2 = Custom[UI.DropDown Data](InputName=code_block_60, Keys=python_script_2, Values=python_script_2, DefaultValueIndex=code_block_61)
string_2 = StringInput("""Made by Pierpaolo Canini
https://www.linkedin.com/in/pierpaolocanini/""")
ui_textnote_data_2 = Custom[UI.TextNote Data](TextNote=string_2)
list_create_3 = List.Create(item0=ui_textnote_data, item1=ui_dropdown_data, item2=ui_textbox_data, item3=ui_dropdown_data_2, item4=ui_textnote_data_2)
code_block_62 = CodeBlock { true; }
code_block_63 = CodeBlock(a=code_block_62, b=boolean) { [a,b][0]; }
string_3 = StringInput("https://www.linkedin.com/in/pierpaolocanini/")
ui_multipleinputform = Custom[UI.MultipleInputForm ++](Description_optional=code_block_52, Logo_optional=code_block_53.lg, ButtonText_optional=code_block_53.out1, Inputs=list_create_3, Toggle=code_block_63, LinkToHelp_optional=string_3, CancelButtonText_optional=code_block_53.out2)  # package Data-Shapes; Create a form with multiple inputs. see www.data-shapes.net for tutorials and infos!
code_block_64 = CodeBlock(a=ui_multipleinputform.User_Inputs) { a[1]; a[0]; a[2]; }
code_block_65 = CodeBlock {  }

code_block_66 = CodeBlock(viewCode=code_block_45, num=firstItem_3, customN=code_block_64.out0, sheet=code_block_64.out1, viewTemplateName=code_block_64.out2) { viewCode; num; customN; sheet; viewTemplateName; }
code_block_67 = CodeBlock(viewCode=code_block_66.viewCode, num=code_block_66.num, customN=code_block_66.customN, sheet=code_block_66.sheet, viewTemplateName=code_block_66.viewTemplateName) { viewCode; num; customN; sheet; viewTemplateName; }

# group: Places all the views in the right order and position in the selected sheets, sets the final names and sets the section boxes to do the trick
python_script_3 = Python(IN[0]=byEyePointAndTarget, IN[1]=code_block_67.viewTemplateName)
# ---------- python_script_3.python (49 lines) ----------
#template for python nodes in dynamo 1.0
#proposed by Julien Benoit @jbenoit44 
#http://aecuandme.wordpress.com/
import clr
clr.AddReference('ProtoGeometry')
from Autodesk.DesignScript.Geometry import *
# Import ToDSType(bool) extension method
clr.AddReference("RevitNodes")
import Revit
clr.ImportExtensions(Revit.Elements)
# Import geometry conversion extension methods
clr.ImportExtensions(Revit.GeometryConversion)
# Import DocumentManager and TransactionManager
clr.AddReference("RevitServices")
import RevitServices
from RevitServices.Persistence import DocumentManager
from RevitServices.Transactions import TransactionManager
from System.Collections.Generic import *
# Import RevitAPI
clr.AddReference("RevitAPI")
import Autodesk
from Autodesk.Revit.DB import *

doc = DocumentManager.Instance.CurrentDBDocument
uiapp = DocumentManager.Instance.CurrentUIApplication
app = uiapp.Application
uidoc=DocumentManager.Instance.CurrentUIApplication.ActiveUIDocument

viewTempName = IN[1]
views = []
for i in IN[0]:
	views.append(UnwrapElement(i))

# Start Transaction
TransactionManager.Instance.EnsureInTransaction(doc)

collector = FilteredElementCollector(doc).OfClass(View)
for i in collector:
	if i.IsTemplate == True and i.Name == viewTempName:
		viewTemp = i

for i in views:
	i.ViewTemplateId = viewTemp.Id
		

# End Transaction
TransactionManager.Instance.TransactionTaskDone()

OUT=views
# ----------------------------------------
flatten_6 = List.Flatten(list=python_script_3)
byCoordinates = Point.ByCoordinates()
ʳʰʸᵗʰᵐ_viewport_create = Rhythm.Revit.Elements.Viewport.Create(sheet=code_block_67.sheet, view=flatten_6, location=byCoordinates)
code_block_68 = CodeBlock(a=flatten_6, b=ʳʰʸᵗʰᵐ_viewport_create) { [a,b][0]; }
code_block_69 = CodeBlock(a=removeItemAtIndex_8) { a; }
count_2 = List.Count(list=code_block_69)
code_block_70 = CodeBlock(x=count_2) { 1..x; }
string_from_object_2 = FromObject(obj=code_block_70)
code_block_71 = CodeBlock { 3; "0"; }
padLeft_2 = String.PadLeft(str=string_from_object_2, newWidth=code_block_71.out0, padChars=code_block_71.out1)
code_block_72 = CodeBlock(viewCode=code_block_67.viewCode, num=code_block_67.num, customN=code_block_67.customN, count=padLeft_2) { viewCode+num+"_"+customN+"_"+count; }
setName = Custom[Element.SetName](element=code_block_68, name=code_block_72)  # package Clockwork for Dynamo 2.x; Gets the name of a given Revit element
ʳʰʸᵗʰᵐ_view3d_setsectionbox = Rhythm.Revit.Views.View3D.SetSectionBox(view3D=setName.element@L1, bBox=code_block_69@L1)
